# Grasshopper definition SpacePartition.gh (Grasshopper 1.0.7)
# plug-ins: FloorsAndVolumes, Human, PTComponentLibrary

# ---- group: Areas
number = Number(Tree({0;0}: [3], {0;1}: [3], {0;2}: [3], {0;3}: [1], {0;4}: [5], {0;5}: [4]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))

# ---- group: Topology
integer = Integer(Tree({0}: [7], {1}: [7], {2}: [3], {3}: [2, 11], {4}: [16, 21, 19], {5}: [19]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))

# ---- group: ID
integer_2 = Integer(Tree({0;0}: [5], {0;1}: [5], {0;2}: [5], {0;3}: [5], {0;4}: [5], {0;5}: [5]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))

# ----
path_mapper = PathMapper(integer, source="{A;B}", target="{A}")
path_mapper_2 = PathMapper(integer_2, source="{A;B}", target="{A}")
path_mapper_3 = PathMapper(number, source="{A;B}", target="{A}")
prunelastbranch = CSharpScript(branches=path_mapper_3)  # -> prunedTree, branchCounter; inputs branches: tree of String
# ---------- prunelastbranch: C# ----------
    var treeOut = new DataTree<string>();

    for( int i = 0; i < branches.BranchCount - 1; ++i )
      treeOut.AddRange(branches.Branch(i), new GH_Path(i));

    prunedTree = treeOut;
    branchCounter = treeOut.BranchCount;
# ---------- end prunelastbranch ----------

# ---- group: Grid / Controllers
number_slider = Slider(18, range=0..20)
number_slider_2 = Slider(4, range=0..5)
division = Division(A=Slider(8, range=0..10), B=Slider(8, range=0..10))
division_2 = Division(A=Slider(8, range=0..10), B=Slider(3, range=0..10))
number_slider_3 = Slider(0, range=0..1)

# ----
mass_addition = MassAddition(Input=prunelastbranch.prunedTree)  # -> Result, PartialResults
panel = Panel(prunelastbranch.prunedTree)

# ---- group: Voronoi / Controllers
number_slider_4 = Slider(4, range=0..25)
seedsy = GenePool(Decimals=2, Maximum=1, Minimum=0, Value=[0.05974284702, 0.87, 0.27, 0.45])
seedsx = GenePool(Decimals=2, Maximum=1, Minimum=0, Value=[0.3301453271, 0.2429782829, 0.689192837, 0.8961875736])

# ----
number_slider_5 = Slider(0, range=0..50)
panel_3 = Panel(mass_addition.Result)
subtraction = Subtraction(A=mass_addition.Result, B=2)
addition = Addition(A=mass_addition.Result, B=2)

# ---- group: Grid
number_slider_6 = Slider(22, range=0..100)
construct_domain = ConstructDomain(DomainStart=Slider(0, range=0..100), DomainEnd=Slider(4, range=0..10))
genepoolmodifier = GenePoolModifier(GeneList="Weights", Count=expr("x+1", number_slider_6), Domain=construct_domain)
knot_vector = KnotVector(Count=expr("x+1", number_slider_6), Degree=Slider(2, range=0..10), Periodic=False)
dom = ConstructDomain(DomainStart=expr("-x", number_slider), DomainEnd=number_slider)
range = Range(Domain=dom, Steps=number_slider_6)
dom_2 = ConstructDomain(DomainStart=expr("-x", number_slider_2), DomainEnd=number_slider_2)
weights = GenePool(Decimals=2, Maximum=4, Minimum=0, Value=[2, 2, 2, 2, 2, 2, 2, 2, 2, 2, 2, 2, 2, 2, 2, 2, 2, 2, 2, 2, 2, 2, 2])
unit_x = UnitX(Factor=Slider(17.8173, range=-50..20))
point = Point(Point(-27.55069635, 0.2364199029, 0))
deconstruct_domain = DeconstructDomain(Domain=dom)  # -> Start, End
rectangle = Rectangle(Plane=point, XSize=dom_2, YSize=dom, Radius=0)  # -> Rectangle, Length
unit_y = UnitY(Factor=deconstruct_domain.Start)
colour_rgb = ColourRGB(Alpha=255, Red=Slider(1000, range=0..1000), Green=Slider(0, range=0..1000), Blue=Slider(0, range=0..1000))
move = Move(Geometry=point, Motion=unit_y)  # -> Geometry, Transform
crv = Curve(rectangle.Rectangle)
ptsrfdomlen = SurfaceDomainLength(Surface=crv, ULength=division_2, VLength=division)

# ---- group: Grid / Perlin
number_slider_7 = Slider(13.910642, range=0..100)
perlinnoise = CSharpScript(
    x=range,
    fre=Slider(2.2, range=0..10),
    amp=Slider(0.575734, range=0..1),
    iter=Slider(4, range=0..10),
    t=Slider(27.513073, range=0..100),
    seed=Slider(1000, range=0..1000))  # -> out, A; inputs x: Double, fre: Double, amp: Double, iter: Int32, t: Double, seed: Int32
# ---------- perlinnoise: C# ----------
    //time+=1e-7;
    
    A = fbm(new vec3(x, 0, 0) + t, fre, amp, iter, seed);
# ---------- perlinnoise: C# additional code ----------
  //double time = 0;
  
  double hash(double a, int seed)
  {

    //return fract(Math.Sin(a) * 4513.15);
    var rand = new Random( seed );
    return rand.NextDouble() * ( 1.0 + 1.0 ) - 1.0;

  }

  double noise(vec3 x, int seed)
  {

    vec3 p = x.floor();
    vec3 k = x.fract();

    k *= k * k * ( 3.0 - 2.0 * k );

    double n = p.X() + p.Y() * 57.0 + p.Z() * 113.0;

    double a = hash(n, seed);
    double b = hash(n + 1.0, seed);
    double c = hash(n + 57.0, seed);
    double d = hash(n + 58.0, seed);

    double e = hash(n + 113.0, seed);
    double f = hash(n + 114.0, seed);
    double g = hash(n + 170.0, seed);
    double h = hash(n + 171.0, seed);

    double res = vec3.mix(vec3.mix(vec3.mix(a, b, k.X()), vec3.mix(c, d, k.X()), k.Y()),
      vec3.mix(vec3.mix(e, f, k.X()), vec3.mix(g, h, k.X()), k.Y()),
      k.Z()
      );

    return res;

  }

  double fbm(vec3 f, double freq, double ampl, int iter, int seed)
  {

    double amp = 1.0, fre = 1.7, res = 0.0;

    for( int i = 0; i < iter; ++i )
    {

      amp *= ampl;
      fre *= freq;

      amp += amp;

      res += amp * noise(fre * f, seed);

    }

    return res;

  }

  class vec3
  {

    double x, y, z;

    public vec3(double x, double y, double z)
    {

      this.x = x;
      this.y = y;
      this.z = z;

    }

    public vec3(Point3d point)
    {

      this.x = point.X;
      this.y = point.Y;
      this.z = point.Z;

    }

    public double X()
    {

      return x;

    }

    public double Y()
    {

      return y;

    }

    public double Z()
    {

      return z;

    }

    // Addition operator overload.
    public static vec3 operator+( vec3 x, vec3 y )
    {

      return new vec3(x.X() + y.X(), x.Y() + y.Y(), x.Z() + y.Z());

    }

    public static vec3 operator+( vec3 x, double y )
    {

      return new vec3(x.X() + y, x.Y() + y, x.Z() + y);

    }

    public static vec3 operator+( double y, vec3 x )
    {

      return new vec3(y + x.X(), y + x.Y(), y + x.Z());

    }

    // Subtraction operator overload.
    public static vec3 operator-( vec3 x, vec3 y )
    {

      return new vec3(x.X() - y.X(), x.Y() - y.Y(), x.Z() - y.Z());

    }

    public static vec3 operator-( vec3 x, double y )
    {

      return new vec3(x.X() - y, x.Y() - y, x.Z() - y);

    }

    public static vec3 operator-( double y, vec3 x )
    {

      return new vec3(y - x.X(), y - x.Y(), y - x.Z());

    }

    // Multiplication operator overload.
    public static vec3 operator*( vec3 x, vec3 y )
    {

      return new vec3(x.X() * y.X(), x.Y() * y.Y(), x.Z() * y.Z());

    }

    public static vec3 operator*( vec3 x, double y )
    {

      return new vec3(x.X() * y, x.Y() * y, x.Z() * y);

    }

    public static vec3 operator*( double y, vec3 x )
    {

      return new vec3(y * x.X(), y * x.Y(), y * x.Z());

    }

    // Fractional part of a vec3.
    public vec3 fract()
    {

      return new vec3(fract(x), fract(y), fract(y));

    }

    // Floor.
    public vec3 floor()
    {

      return new vec3(Math.Floor(x), Math.Floor(y), Math.Floor(z));

    }

    // Fractional part of a double.
    public double fract(double x)
    {

      return x - Math.Truncate(x);

    }

    // Linear interpolation of a double.
    public static double mix(double a, double b, double c)
    {

      return a - ( 1 - c ) + b * c;

    }

    // Linear interpolation of a vec3.
    public static vec3 mix(vec3 a, vec3 b, double c)
    {

      double mixX = mix(a.X(), b.X(), c);
      double mixY = mix(a.Y(), b.Y(), c);
      double mixZ = mix(a.Z(), b.Y(), c);

      return new vec3(mixX, mixY, mixZ);

    }

    public Point3d toPoint()
    {

      return new Point3d(this.X(), this.Y(), this.Z());

    }

  }

  public double fract(double x)
  {

    return x - Math.Truncate(x);

  }
# ---------- end perlinnoise ----------

# ---- group: Grid (continued)
construct_point = ConstructPoint(XCoordinate=perlinnoise.A, YCoordinate=range, ZCoordinate=0)
list_item = ListItem(List=construct_point, Index=0, Wrap=True)
vector_2pt = Vector2Pt(PointA=list_item, PointB=move.Geometry, Unitize=False)  # -> Vector, Length
move_2 = Move(Geometry=construct_point, Motion=vector_2pt.Vector)  # -> Geometry, Transform
nurbs_curve_pwk = NurbsCurvePWK(Points=move_2.Geometry, Weights=weights, Knots=knot_vector)  # -> Curve, Length, Domain
custom_preview_lineweights = CustomPreviewLineweights(Geometry=nurbs_curve_pwk.Curve, Shader=colour_rgb, Thickness=Slider(3.01, range=0..10), Absolute=False)
curve_attraction = CurveAttraction(Grid=ptsrfdomlen, CrvAtts=nurbs_curve_pwk.Curve, Magnitude=number_slider_3)  # -> Grid, Weights
ptborders = GenerateBorders(Grid=curve_attraction.Grid, PanelShape=0)  # -> simplify(Border)
crv_2 = Curve(flatten(ptborders))

# ---- group: Voronoi
dom_3 = ConstructDomain(DomainStart=expr("-x", 0), DomainEnd=1)
genemodifier = GenePoolModifier(GeneList="SeedsX", Count=number_slider_4, Domain=dom_3)
genemodifier_2 = GenePoolModifier(GeneList="SeedsY", Count=number_slider_4, Domain=dom_3)
pt = ConstructPoint(XCoordinate=seedsx, YCoordinate=seedsy, ZCoordinate=0)
evalsrf = EvaluateSurface(Surface=reparameterize(crv), Point=pt)  # -> Point, Normal, UDirection, VDirection, Frame
pt_2 = Point(evalsrf.Point)
voronoi = Voronoi(Points=pt_2, Boundary=rectangle.Rectangle, BruteForceOverride=False)

# ---- group: ManhattanVoronoi
number_slider_8 = Slider(10, range=0..10)  # disabled
ghpython_script = GhPythonScript(r=number_slider_8, P=pt_2)  # -> out, PL; inputs P: list of Point3d; disabled
# ---------- ghpython_script: Python ----------
__author__ = "Paula"
__version__ = "2019.04.23"

import rhinoscriptsyntax as rs
from Rhino.Geometry import Point3d as P3
from Rhino.Geometry import Polyline as PLine

def taxicab_midnormal ( Point_1 = P3(0,0,0), Point_2 = P3(0,0,0) , leng = 10000):
    dx = abs(Point_1.X - Point_2.X)
    dy = abs(Point_1.Y - Point_2.Y)
    
    C = P3 ( ( Point_1.X + Point_2.X ) / 2, ( Point_1.Y + Point_2.Y ) / 2, ( Point_1.Z + Point_2.Z ) / 2)
    
    """ MPQN, in which M is on the lengeft(X-) or bottom(Y-) """
    P = P3 (0,0,C.Z)
    Q = P3 (0,0,C.Z)
    M = P3 (0,0,C.Z)
    N = P3 (0,0,C.Z)
    
    if dx > dy:
        P.Y = C.Y + dy / 2
        Q.Y = C.Y - dy / 2
        M.Y = P.Y + leng
        N.Y = Q.Y - leng
        if bool(Point_1.Y > Point_2.Y) ^ bool(Point_1.X > Point_2.X):
            P.X = C.X + dy / 2
            Q.X = C.X - dy / 2
        else:
            P.X = C.X - dy / 2
            Q.X = C.X + dy / 2
        M.X = P.X
        N.X = Q.X
    else:
        if dx < dy:
            P.X = C.X + dx / 2
            Q.X = C.X - dx / 2
            M.X = P.X + leng
            N.X = Q.X - leng
            if bool(Point_1.Y > Point_2.Y) ^ bool(Point_1.X > Point_2.X):
                P.Y = C.Y + dx / 2
                Q.Y = C.Y - dx / 2
            else:
                P.Y = C.Y - dx / 2
                Q.Y = C.Y + dx / 2
            M.Y = P.Y
            N.Y = Q.Y
        else:
            if bool(Point_1.Y > Point_2.Y) ^ bool(Point_1.X > Point_2.X):
                P.Y = C.Y - dx / 2
                Q.Y = C.Y + dx / 2
                P.X = C.X - dy / 2
                Q.X = C.X + dy / 2
                M.Y = P.Y - leng
                M.X = P.X - leng
                N.Y = Q.Y + leng
                N.X = Q.X + leng
            else:
                P.Y = C.Y - dx / 2
                Q.Y = C.Y + dx / 2
                P.X = C.X + dy / 2
                Q.X = C.X - dy / 2
                M.Y = P.Y - leng
                M.X = P.X + leng
                N.Y = Q.Y + leng
                N.X = Q.X - leng

    return rs.AddPolyline( [M , P , Q , N] )

def taxicab_circle ( point = P3(0,0,0), r = 1 ):
    A = P3( point.X + r, point.Y, point.Z )
    B = P3( point.X, point.Y + r, point.Z )
    C = P3( point.X - r, point.Y, point.Z )
    D = P3( point.X, point.Y - r, point.Z )
    return rs.AddPolyline( [A, B, C, D, A] )

l = 2 * r

""" PL = taxicab_midnormal ( A, B, r ) """

pts = P

polylines = []
for i in range( len( P ) ):
    polylines.append(taxicab_circle( P[i], l ))

for i in range(len(polylines)):
    for j in range(i):
        if i == j:
            continue
        if rs.CurveBooleanUnion( [ polylines[i], polylines[j] ] ):
            MN = taxicab_midnormal( pts[i], pts[j], l )
            
            ccx = rs.CurveCurveIntersection( polylines[i], MN )
            if ccx is None:
                continue
            if ccx[0][0] == 2:
                continue
            para_a = [ ccx[0][5], ccx[1][5] ]
            para_b = [ ccx[0][7], ccx[1][7] ]
            
            if para_b[0] > para_b[1]:
                para_b = [ para_b[1], para_b[0] ]
            
            probable_dash = rs.SplitCurve(polylines[i], para_a)
            edge = rs.TrimCurve(MN, para_b, False )
            edgepts = rs.CurvePoints(edge)
            
            for crv in probable_dash:
                crvpts = rs.CurvePoints(crv)
                if rs.PointCompare( crvpts[0], edgepts[0] ):
                    crvpts.reverse()
                newpl = rs.AddPolyline( edgepts + crvpts )
                if rs.PointInPlanarClosedCurve( pts[i], newpl ):
                    polylines[i] = newpl
                    break
            
            
            ccx = rs.CurveCurveIntersection( polylines[j], MN )
            if ccx is None:
                continue
            para_a = [ ccx[0][5], ccx[1][5] ]
            para_b = [ ccx[0][7], ccx[1][7] ]
            
            if para_b[0] > para_b[1]:
                para_b = [ para_b[1], para_b[0] ]
            
            probable_dash = rs.SplitCurve(polylines[j], para_a)
            edge = rs.TrimCurve(MN, para_b, False )
            edgepts = rs.CurvePoints(edge)
            
            for crv in probable_dash:
                crvpts = rs.CurvePoints(crv)
                if rs.PointCompare( crvpts[0], edgepts[0] ):
                    crvpts.reverse()
                newpl = rs.AddPolyline( edgepts + crvpts )
                if rs.PointInPlanarClosedCurve( pts[j], newpl ):
                    polylines[j] = newpl
                    break
    

PL = polylines
# ---------- end ghpython_script ----------
region_intersection = RegionIntersection(CurvesA=ghpython_script.PL, CurvesB=rectangle.Rectangle)  # disabled
curve = Curve(region_intersection)  # disabled
surface = Surface(curve)  # disabled

# ----
curve_2 = Curve(voronoi)
surface_2 = Surface(curve_2)
area = Area(Geometry=crv_2, UseTasks=False)  # -> Area, Centroid
sort_list = SortList(Keys=area.Area, ValuesA=area.Area)  # -> Keys, ValuesA
list_length = ListLength(List=sort_list.ValuesA)
subtraction_2 = Subtraction(A=list_length, B=1)
list_item_2 = ListItem(List=sort_list.ValuesA, Index=subtraction_2, Wrap=True)
multiplication = Multiplication(A=list_item_2, B=Slider(0.5, range=0..1))
c_script = CSharpScript(voronoiIn=curve_2, gridIn=crv_2, areaIn=multiplication, seed=Slider(3686, range=0..10000))  # -> culledGrid, R, G, B; inputs voronoiIn: list of Polyline, gridIn: list of Polyline, areaIn: Double, seed: Int32
# ---------- c_script: C# usings ----------
using System.Linq;
# ---------- c_script: C# ----------
    var intersections = new DataTree<Curve>();
    var repeated = new DataTree<Polyline>();
    var bools = new DataTree<bool>();

    for( int i = 0; i < voronoiIn.Count; ++i )
    {

      repeated.AddRange(gridIn, new GH_Path(i));

      for( int j = 0; j < gridIn.Count; ++j )
      {

        intersections.AddRange(Curve.CreateBooleanIntersection(voronoiIn[i].ToNurbsCurve(), gridIn[j].ToNurbsCurve(), 1e-7).ToList(), new GH_Path(i, j));

      }

    }

    for( int i = 0; i < intersections.BranchCount; ++i )
    {

      var tempList = intersections.Branch(i);
      var path = new GH_Path(intersections.Path(i).Indices[0]);
      bool temp = false;

      if( tempList.Count > 0 )
      {

        temp = AreaMassProperties.Compute(intersections.Branch(i)[0]).Area < areaIn ? false : true;

        bools.Add(temp, path);

      }

      else
      {

        temp = false;
        bools.Add(temp, path);

      }

    }

    var treeOut = new DataTree<Polyline>();
    var coloursOutR = new DataTree<int>();
    var coloursOutG = new DataTree<int>();
    var coloursOutB = new DataTree<int>();
    //var coloursOut = new DataTree<System.Drawing.Color>();
    var rand = new Random(seed);

    for( int i = 0; i < bools.BranchCount; ++i )
    {

      var path = repeated.Path(i);

      coloursOutR.Add(rand.Next(0, 255), path);
      coloursOutG.Add(rand.Next(0, 255), path);
      coloursOutB.Add(rand.Next(0, 255), path);
      //coloursOut.Add( System.Drawing.Color.FromArgb( 255, rand.Next( 0, 255 ), rand.Next( 0, 255 ), rand.Next( 0, 255 ) ), path );

      for( int j = 0; j < bools.Branch(i).Count; ++j )
      {

        if( bools.Branch(i)[j] == true )
        {

          treeOut.Add(repeated.Branch(i)[j], path);

        }

      }

    }

    culledGrid = treeOut;
    R = coloursOutR;
    G = coloursOutG;
    B = coloursOutB;
    //R = coloursOut;
# ---------- end c_script ----------
panel_4 = Panel(c_script.culledGrid)
colour_rgb_2 = ColourRGB(Alpha=Slider(64, range=0..255), Red=c_script.R, Green=c_script.G, Blue=c_script.B)
region_union = RegionUnion(Curves=c_script.culledGrid)
colour_rgb_3 = ColourRGB(Alpha=Slider(255, range=0..255), Red=c_script.R, Green=c_script.G, Blue=c_script.B)
custom_preview = CustomPreview(Geometry=graft(surface_2), Material=colour_rgb_2)
surface_3 = Surface(region_union)
area_2 = Area(Geometry=surface_3, UseTasks=False)  # -> Area, Centroid
custom_preview_2 = CustomPreview(Geometry=surface_3, Material=colour_rgb_3)
panel_5 = Panel(area_2.Area)
expression = Expression(x=area_2.Area, y=addition, z=subtraction, Expression="If( ( x < y) And ( x > z), 0, 1000 )")
panel_6 = Panel(expression)
flatten_tree = FlattenTree(Tree=surface_3, Path="{0}")
list_length_2 = ListLength(List=flatten_tree)
list_length_3 = ListLength(List=crv_2)  # disabled
panel_7 = Panel(list_length_2)
expression_2 = Expression(x=list_length_3, y=list_length_2, Expression="If( x ≠ y, False, True )")  # disabled
panel_8 = Panel(expression_2)  # disabled
